# Grasshopper definition rug-pattern.ghx (Grasshopper 0.9.76)
# plug-ins: Pufferfish, Wombat

pt = Point(<point referenced from the Rhino model>)

# ----
# MODULE 1
panel = Panel("Demo Diamond")
number_slider = Slider(3, range=0..10)

pt_2 = Point(<point referenced from the Rhino model>)
# INNER CIRCLE
X = UnitX(Factor=1)
# MODULE 2
number_slider_2 = Slider(1, range=0..1)
neg = Negative(Value=Slider(2, range=0..10))
addition = Addition(A=pt, B=X)
pt_3 = Point(<point referenced from the Rhino model>)
pt_4 = Point(<point referenced from the Rhino model>)
vec = VectorXYZ(XComponent=0, YComponent=neg, ZComponent=0)  # -> Vector, Length
panel_2 = Panel("Demo Arcs")
# INNER SQUARE
polygon = Polygon(Plane=pt, Radius=number_slider, Segments=Slider(4, range=0..10), FilletRadius=0)  # -> Polygon, Length
pdecon = Deconstruct(Point=pt_3)  # -> XComponent, YComponent, ZComponent
ln = Line(StartPoint=pt, EndPoint=addition)
vec_2 = VectorXYZ(XComponent=number_slider, YComponent=number_slider, ZComponent=0)  # -> Vector, Length
number_slider_3 = Slider(4, range=0..10)
Z = UnitZ(Factor=1)
X_2 = UnitX(Factor=1)
move = Move(Geometry=pt_2, Motion=vec.Vector)  # -> Geometry, Transform
pi = Pi(Factor=2)
pdecon_2 = Deconstruct(Point=pt_4)  # -> XComponent, YComponent, ZComponent
arrpolar = PolarArray(Geometry=ln, Plane=pt, Count=Slider(12, range=0..100), Angle=6.283185307)  # -> Geometry, Transform
vec_3 = VectorXYZ(XComponent=number_slider_2, YComponent=Slider(0.4, range=0..1), ZComponent=0)  # -> Vector, Length
addition_2 = Addition(A=pt, B=vec_2.Vector)
arc = Arc(Plane=move.Geometry, Radius=1, Angle=Slider(0.62, range=0.1..1))  # -> Arc, Length
pt_5 = ConstructPoint(XCoordinate=pdecon_2.XComponent, YCoordinate=pdecon.YComponent, ZCoordinate=0)
vec_4 = VectorXYZ(XComponent=Slider(1.9, range=0..10), YComponent=0, ZComponent=0)  # -> Vector, Length
cir = Circle(Plane=pt, Radius=1)
move_2 = Move(Geometry=pt_2, Motion=X_2)  # -> Geometry, Transform
division = Division(A=pi, B=number_slider_3)
end = EndPoints(Curve=arc.Arc)  # -> Start, End
pt_6 = Point(pt)
ln_2 = Line(StartPoint=pt, EndPoint=addition_2)
mp = Midpoint(Curve=arc.Arc)

# ---- group: series-based construction
number_slider_4 = Slider(5, range=0..10)
panel_3 = Panel("1")
neg_2 = Negative(Value=Slider(0.285, range=0..1))
series = Series(Start=panel_3, Step=Slider(0.129, range=0..1), Count=number_slider_4)
pt_7 = Point(move.Geometry)
series_2 = Series(Start=0, Step=neg_2, Count=number_slider_4)

# ----
# TRIANGLES
addition_3 = Addition(A=pt_2, B=vec_4.Vector)
Z_2 = UnitZ(Factor=1)
merge = Merge(Data1=pt_4, Data2=pt_5, Data3=pt_3)
pl = ConstructPlane(Origin=pt_2, XAxis=vec_3.Vector, YAxis=Z)
addition_4 = Addition(A=number_slider, B=Slider(1, range=0..10))
series_3 = Series(Start=0, Step=division, Count=number_slider_3)
vec2pt = Vector2Pt(PointA=end.Start, PointB=end.End, Unitize=False)  # -> Vector, Length
# ARCS
xy = XYPlane(Origin=mp)
cir_2 = Circle(Plane=move_2.Geometry, Radius=Slider(0.358, range=0..1))
polygon_2 = Polygon(Plane=addition_3, Radius=Slider(0.5, range=0..1), Segments=Slider(3, range=0..10), FilletRadius=0)  # -> Polygon, Length
nurbs = NurbsCurve(Vertices=merge, Degree="2", Periodic=False)  # -> Curve, Length, Domain
Y = UnitY(Factor=addition_4)
pl_2 = ConstructPlane(Origin=end.Start, XAxis=vec2pt.Vector, YAxis=Z_2)
# NESTED CIRCLES
rotate = Rotate(Geometry=pl, Angle=series_3, Plane=pt_2)  # -> Geometry, Transform
# DIAMOND
number_slider_5 = Slider(0.66, range=0..1)
addition_5 = Addition(A=pt, B=Y)
mirror = Mirror(Geometry=cir_2, Plane=pl)  # -> Geometry, Transform
# BOOMERANGS
offcrv = OffsetCurve(
    Curve=nurbs.Curve,
    Distance=Slider(0.37, range=0..1),
    Plane=PlaneXY(0, 0, 0),
    BothSides=invert(False),
    Kinks=0,
    CapType=Slider(3, range=0..3))
range = Range(Domain=Domain(0, 1), Steps=Slider(100, range=0..1000))
mirror_2 = Mirror(Geometry=arc.Arc, Plane=pl_2)  # -> Geometry, Transform

# ---- group: domain-based construction
neg_3 = Negative(Value=Slider(0.94, range=0.5..1.5))
subtraction = Subtraction(A=Slider(5, range=0..10), B=1)
dom = ConstructDomain(DomainStart=0, DomainEnd=neg_3)
dom_2 = ConstructDomain(DomainStart=panel_3, DomainEnd=Slider(1.05, range=1.05..2))
range_2 = Range(Domain=dom_2, Steps=subtraction)
range_3 = Range(Domain=dom, Steps=subtraction)
scale = Scale(Geometry=mirror_2.Geometry, Center=pt_7, Factor=range_2)  # -> Geometry, Transform
rotate_2 = Rotate(Geometry=scale.Geometry, Angle=range_3, Plane=pt_7)  # -> Geometry, Transform

# ----
neg_4 = Negative(Value=Slider(1, range=0..1))
pt_8 = Point(pt_2)
merge_2 = Merge(Data1=mirror.Geometry, Data2=cir_2)
polygon_3 = Polygon(Plane=addition_5, Radius=number_slider_5, Segments=Slider(4, range=0..10), FilletRadius=0)  # -> Polygon, Length
eval = EvaluateCurve(Curve=reparameterize(offcrv), Parameter=range)  # -> Point, Tangent, Angle
scale_nu = ScaleNU(Geometry=polygon_2.Polygon, Plane=addition_3, ScaleX=1, ScaleY=Slider(2.6, range=0..10), ScaleZ=1)  # -> Geometry, Transform
scale_2 = Scale(Geometry=scale_nu.Geometry, Center=pt_8, Factor=neg_4)  # -> Geometry, Transform
scale_3 = Scale(Geometry=mirror_2.Geometry, Center=pt_7, Factor=series)  # -> Geometry, Transform
orient = Orient(Geometry=graft(merge_2), Source=pl, Target=rotate.Geometry)  # -> Geometry, Transform
scale_nu_2 = ScaleNU(Geometry=polygon_3.Polygon, Plane=addition_5, ScaleX=1, ScaleY=Slider(1.5, range=0..10), ScaleZ=1)  # -> Geometry, Transform
rotate_3 = Rotate(Geometry=xy, Angle=series_2, Plane=pt_7)  # -> Geometry, Transform
X_3 = UnitX(Factor=number_slider)
crv_cp = CurveClosestPoint(Point=eval.Point, Curve=reparameterize(nurbs.Curve))  # -> Point, Parameter, Distance
mp_2 = Midpoint(Curve=scale_3.Geometry)
pi_2 = Pi(Factor=2)
area = Area(Geometry=orient.Geometry)  # -> Area, Centroid
addition_6 = Addition(A=pt, B=X_3)
xy_2 = XYPlane(Origin=mp_2)
subtraction_2 = Subtraction(A=Slider(8, range=0..10), B="2")
division_2 = Division(A=pi_2, B=subtraction_2)
subtraction_3 = Subtraction(A=crv_cp.Parameter, B=Slider(0.5, range=0..1))
orient_2 = Orient(Geometry=scale_3.Geometry, Source=xy_2, Target=rotate_3.Geometry)  # -> Geometry, Transform
xy_3 = XYPlane(Origin=addition_6)
scale_4 = Scale(Geometry=orient.Geometry, Center=area.Centroid, Factor=Slider(0.56, range=0..1))  # -> Geometry, Transform
pi_3 = Pi(Factor=1)
series_4 = Series(Start=0, Step=division_2, Count=subtraction_2)
abs = Absolute(Value=subtraction_3)
multiplication = Multiplication(A=abs, B=1.999)
prot = RotatePlane(Plane=xy_3, Angle=pi_3)
scale_5 = Scale(Geometry=scale_4.Geometry, Center=pt_2, Factor=Slider(0.84, range=0..1))  # -> Geometry, Transform
number_slider_6 = Slider(0.6, range=0..1)
pt_9 = Point(pt_2)
geo = Geometry(orient_2.Geometry)
number_slider_7 = Slider(8, range=0..10)
subtraction_4 = Subtraction(A=Slider(1, range=0..1), B=multiplication)
pt_10 = Point(addition_6)
polygon_4 = Polygon(Plane=prot, Radius=Slider(1, range=0..1), Segments=Slider(3, range=0..10), FilletRadius=0)  # -> Polygon, Length
vec_5 = VectorXYZ(XComponent=Slider(2.4, range=0..10), YComponent=Slider(1.9, range=0..10), ZComponent=0)  # -> Vector, Length
pt_11 = Point(pt_2)
scale_6 = Scale(Geometry=eval.Point, Center=crv_cp.Point, Factor=subtraction_4)  # -> Geometry, Transform
X_4 = UnitX(Factor=Slider(2, range=0..10))
move_3 = Move(Geometry=pt_11, Motion=vec_5.Vector)  # -> Geometry, Transform
X_5 = UnitX(Factor=number_slider_6)
division_3 = Division(A=number_slider_7, B=2)
scale_nu_3 = ScaleNU(Geometry=geo, Plane=pt_9, ScaleX=neg_4, ScaleY=1, ScaleZ=1)  # -> Geometry, Transform
# FLOWER
xz = XZPlane(Origin=pt_10)
scale_nu_4 = ScaleNU(Geometry=geo, Plane=pt_9, ScaleX=1, ScaleY=neg_4, ScaleZ=1)  # -> Geometry, Transform
scale_7 = Scale(Geometry=geo, Center=pt_9, Factor=neg_4)  # -> Geometry, Transform
pline = PolyLine(Vertices=scale_6.Geometry, Closed=False)
Y_2 = UnitY(Factor=number_slider_6)
move_4 = Move(Geometry=pt_10, Motion=X_4)  # -> Geometry, Transform
polygon_5 = Polygon(Plane=move_3.Geometry, Radius=Slider(0.85, range=0..1), Segments=number_slider_7, FilletRadius=0)  # -> Polygon, Length
move_5 = Move(Geometry=move_4.Geometry, Motion=X_5)  # -> Geometry, Transform
repeat = RepeatData(Data="1", Length=division_3)
repeat_2 = RepeatData(Data="0", Length=division_3)
move_6 = Move(Geometry=move_4.Geometry, Motion=Y_2)  # -> Geometry, Transform
merge_3 = Merge(Data1=repeat_2, Data2=repeat)
disc = Discontinuity(Curve=polygon_5.Polygon, Level=1)  # -> Points, Parameters
neg_5 = Negative(Value=Slider(1, range=0..1))
ln_3 = Line(StartPoint=move_6.Geometry, EndPoint=move_5.Geometry)
not = GateNot(A=merge_3)
scale_nu_5 = ScaleNU(Geometry=ln_3, Plane=move_4.Geometry, ScaleX=1, ScaleY=neg_5, ScaleZ=1)  # -> Geometry, Transform
cull = CullPattern(List=disc.Points, CullPattern=merge_3)
neg_6 = Negative(Value=Slider(2.5, range=0..10))
cull_2 = CullPattern(List=disc.Points, CullPattern=not)
# GEMS
number_slider_8 = Slider(0.3, range=0..1)
join = JoinCurves(Curves=[scale_nu_5.Geometry, ln_3], Preserve=False)
number_slider_9 = Slider(3, range=0..10)
avr = Average(Input=cull)
merge_4 = Merge(Data1=cull_2, Data2=avr)
scale_nu_6 = ScaleNU(Geometry=join, Plane=move_4.Geometry, ScaleX=neg_6, ScaleY=1, ScaleZ=1)  # -> Geometry, Transform
pi_4 = Pi(Factor=Slider(0.5, range=0..1))
neg_7 = Negative(Value=Slider(0.11, range=0..1))
pi_5 = Pi(Factor=number_slider_8)
pline_2 = PolyLine(Vertices=merge_4, Closed=invert(False))
join_2 = JoinCurves(Curves=[scale_nu_6.Geometry, join], Preserve=False)
series_5 = Series(Start=Slider(1, range=0..1), Step=neg_7, Count=number_slider_9)
division_4 = Division(A=pi_4, B=number_slider_9)
disc_2 = Discontinuity(Curve=join_2, Level=1)  # -> Points, Parameters
rotate_4 = Rotate(Geometry=pline_2, Angle=pi_5, Plane=move_3.Geometry)  # -> Geometry, Transform
cp = ClosestPoint(Point=pt_10, Cloud=disc_2.Points)  # -> ClosestPoint, CPIndex, Distance
series_6 = Series(Start=0, Step=division_4, Count=number_slider_9)
scale_8 = Scale(Geometry=join_2, Center=cp.ClosestPoint, Factor=series_5)  # -> Geometry, Transform
pi_6 = Pi(Factor=2)
disc_3 = Discontinuity(Curve=rotate_4.Geometry, Level=1)  # -> Points, Parameters
ln_4 = Line(StartPoint=move_3.Geometry, EndPoint=disc_3.Points)
rotate_5 = Rotate(Geometry=scale_8.Geometry, Angle=series_6, Plane=cp.ClosestPoint)  # -> Geometry, Transform
range_4 = Range(Domain=pi_6, Steps=Slider(4, range=0..10))
group = Group(Objects=flatten([ln_4, rotate_4.Geometry]))
mirror_3 = Mirror(Geometry=rotate_5.Geometry, Plane=xz)  # -> Geometry, Transform
cull_i = CullIndex(List=range_4, Indices="-1", Wrap=True)
merge_5 = Merge(Data1=rotate_5.Geometry, Data2=mirror_3.Geometry)
pi_7 = Pi(Factor=1)
rotate_6 = Rotate(Geometry=group, Angle=cull_i, Plane=pt_11)  # -> Geometry, Transform
group_2 = Group(Objects=merge_5)
ungroup = Ungroup(Group=rotate_6.Geometry)
multiplication_2 = Multiplication(A=Slider(1, range=0.5..2), B=pi_7)
lng = ListLength(List=rotate_6.Geometry)
rotate_7 = Rotate(Geometry=graft([polygon_4.Polygon, scale_nu_2.Geometry, group_2]), Angle=series_4, Plane=pt_6)  # -> Geometry, Transform
item = ListItem(List=ungroup, Index=0, Wrap=True)
series_7 = Series(Start=0, Step=multiplication_2, Count=lng)
pcen = PolygonCenter(Polyline=item)  # -> flatten(CenterV), CenterE, CenterA
rotate_8 = Rotate(Geometry=rotate_6.Geometry, Angle=series_7, Plane=pcen.CenterV)  # -> Geometry, Transform
group_3 = Group(Objects=flatten([pline, rotate_7.Geometry, cir, arrpolar.Geometry, polygon.Polygon]))
group_4 = Group(Objects=flatten([scale_nu.Geometry, scale_2.Geometry, scale_7.Geometry, scale_nu_3.Geometry, scale_nu_4.Geometry, scale_5.Geometry, orient.Geometry, rotate_8.Geometry, geo]))
yz = YZPlane(Origin=pt_2)
pt_12 = Point(<point referenced from the Rhino model>)
neg_8 = Negative(Value=Slider(1, range=0..1))
# TILING
mirror_4 = Mirror(Geometry=group_3, Plane=yz)  # -> Geometry, Transform
scale_9 = Scale(Geometry=group_4, Center=pt_12, Factor=neg_8)  # -> Geometry, Transform
pt_13 = Point(pt_2)
transform = Transform(Geometry=pt_13, Transform=scale_9.Transform)
vec2pt_2 = Vector2Pt(PointA=pt_13, PointB=transform, Unitize=False)  # -> Vector, Length
Z_3 = UnitZ(Factor=1)
pl_3 = ConstructPlane(Origin=pt_12, XAxis=vec2pt_2.Vector, YAxis=Z_3)
mirror_5 = Mirror(Geometry=group_3, Plane=pl_3)  # -> Geometry, Transform
